# Grasshopper definition 7-4-1_ScriptSample.gh (Grasshopper 1.0.8)

# ----
# 基本形状幅
# Z方向の長さ
number_slider = Slider(2.7, range=2..3)

# ----
# 配置される　石の数
number_slider_2 = Slider(108, range=0..120)

# ---- group: "Select one exsisting file"で、pyファイル選択
# link_test.py ファイルを選択
path = FilePath("\\Applicraft-svr3\data\TST\Books&Docs\コンピュテーショナルモデリング-入門から応用\第７章　サンプルアルゴリズム\スクリプト\file\link_test.py")

# ----
# 基本Curve
crv_曲線 = Curve(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)

# ----
# 石留のみ複数のアイテムなので、
# Graftをつけて対応
panel = Panel("5")
Z = UnitZ(Factor=number_slider)
brep_cut形状 = Brep(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)
brep_石 = Brep(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)
brep_石留 = Brep([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])

# ---- group: Per Line のチェックを外す
file = ReadFile(File=path, PerLineParse=False)

# ----
# 範囲(Domain)を
# 指定した数(Steps)で
# 分割した値を出力
range = Range(Domain=Domain(0, 1), Steps=number_slider_2)

# ----
# リビルド
# D が次数
# Nが制御点の数
reb = RebuildCurve(Curve=crv_曲線, Degree=panel, Count="36", Tangents=False)

# ----
# XYをUV値に
# 見立てて使用
panel_2 = Panel("0.5")
pt = ConstructPoint(XCoordinate=panel_2, YCoordinate=range, ZCoordinate=0)

# ----
# Z方向に押し出し
extr = Extrude(Base=reb, Direction=Z)

# ----
# Grasshopperコンポーネントを呼び出して使った場合、
# ghc.EvaluateCurve(curve,tParams)[0]
# [0]
# [1]
# [2]
eval = EvaluateCurve()  # -> Point, Tangent, Angle

rectangle = Rectangle(Plane=PlaneXY(0, 0, 0), XSize=Domain(-1, 1), YSize=Domain(-2, 2), Radius=0)  # -> Rectangle, Length

# ----
# 通常のGHのSort Pointsは
# X,Y,Zの順番のみ
sort_pt = SortPoints()  # -> Points, Indices

# ----
# 指定したUV値の
# UVのベクトル
# 平面(Flames)等を出力
evalsrf = EvaluateSurface(Surface=reparameterize(extr), Point=pt)  # -> Point, Normal, UDirection, VDirection, Frame

offset = OffsetCurve(Curve=rectangle.Rectangle, Distance=1, Corners=1)
py3 = Python3Script(siteCrv=rectangle.Rectangle, roadCrv=offset)  # -> out, flatten(points), curves, breps; inputs siteCrv: Curve, roadCrv: Curve
# ---------- py3: Python ----------
import Rhino.Geometry as rg
from scriptcontext import doc
import Rhino


pts = siteCrv.DivideByCount(40, True)

points = []
curves = []
breps = []

for pt in pts:
    p = siteCrv.PointAt(pt)

    t = roadCrv.ClosestPoint(p)[1]
    closest_pt = roadCrv.PointAt(t)

    dist_vec = p - closest_pt
    horizontal_dist = dist_vec.Length

    max_z = horizontal_dist / 2
    top_pt = rg.Point3d(p.X, p.Y, max_z)    
    
    pt = rg.Point3d(p)
    points.append(pt)

    pt = rg.Point3d(closest_pt)
    points.append(pt)

    pt = rg.Point3d(top_pt)
    points.append(pt)

    curve = rg.Line(p, top_pt)
    curves.append(curve)

    breps.append(rg.Extrusion.Create(curve.ToNurbsCurve(), 0.1, True))

joined = rg.Brep.CreateBooleanUnion([b.ToBrep() for b in breps], doc.ModelAbsoluteTolerance)

breps.append(joined[0])
# ---------- end py3 ----------

# ----
# 平面(Plane)を方向(Direction)に
# 最小の回転で向きを合わせる
align = AlignPlane(Plane=evalsrf.Frame, Direction=evalsrf.VDirection)  # -> Plane, Angle

# ----
# オフセット量　厚み
number_slider_3 = Slider(2, range=0..2)

panel_3 = Panel(py3.points)

# ----
# ジオメトリを平面Aから平面Bに
# 合わせるように移動と回転を
# 同時に行う
orient = Orient(Geometry=graft(brep_石留), Source=PlaneXY(0, 0, 0), Target=align.Plane)  # -> Geometry, Transform
orient_2 = Orient(Geometry=brep_cut形状, Source=PlaneXY(0, 0, 0), Target=align.Plane)  # -> Geometry, Transform
orient_3 = Orient(Geometry=brep_石, Source=PlaneXY(0, 0, 0), Target=align.Plane)  # -> Geometry, Transform

# ---- group: ソリッド化して、サーフェスオフセット
offsetsrfsolid_python = GhPythonScript(x=extr, y=number_slider_3)  # -> a
# ---------- offsetsrfsolid_python: Python ----------
import rhinoscriptsyntax as rs
import Rhino.Geometry as rg
import ghpythonlib.components as ghc

if x :
    if y:
        a = rs.OffsetSurface(x,y,None,False,True)   #ScriptSyntax
# ---------- end offsetsrfsolid_python ----------

# ----
# カット形状
brep = Brep(orient_2.Geometry)

# ----
# 石留
brep_石留_2 = Brep(orient.Geometry)

# ----
# 石
brep_2 = Brep(orient_3.Geometry)

# ----
# 本体形状
brep_本体 = Brep(offsetsrfsolid_python)

loft_curves = Curve([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])
start_point = Point(Point(-8.662265443, 0.4746446818, 11.15335958))
end_point = Point(Point(-8.662265443, 0.4746446818, -27.69026178))

# ---- group: 始点・終点に対してLoft
loft_to_point_python = GhPythonScript(
    curves=loft_curves,
    start_pt=start_point,
    end_pt=end_point,
    Loft_type=Slider(1, range=0..3),
    simplify=Slider(1, range=0..2),
    value=Slider(200, range=0..200),
    Close=Toggle(False))  # -> LoftSrf; inputs curves: list of Curve, start_pt: Point3d, Loft_type: Int32, simplify: Int32, Close: Boolean
# ---------- loft_to_point_python: Python ----------
import rhinoscriptsyntax as rs
import Rhino.Geometry as rg
import ghpythonlib.components as ghcomp

LoftSrf = rs.AddLoftSrf(curves, start_pt,end_pt,Loft_type,simplify ,value,Close)    #ScriptSyntax
# ---------- end loft_to_point_python ----------

# ---- group: 球体にフィボナッチ状に点を作成
fib_sph = GhPythonScript(radius=Slider(10, range=0..10), counts=Slider(500, range=0..500))  # -> out, a, b; inputs counts: Int32
# ---------- fib_sph: Python ----------
import rhinoscriptsyntax as rs
import rhinoscriptsyntax as rs
import math, random

def FibonacciSphere(counts, randomize, radius):
    rnd = 1
    if randomize:
        rnd = random.random() * counts

    points = []
    offset = 2/counts
    increment = math.pi * (3 - math.sqrt(5));

    for i in range(counts):
        y = ((i * offset) - 1) + (offset / 2);
        r = math.sqrt(1 - pow(y,2))

        phi = ((i + rnd) % counts) * increment

        x = math.cos(phi) * r
        z = math.sin(phi) * r

        points.append([x*radius,y*radius,z*radius])

    return points

def SampleFibonacciSphere():
    if counts is None: return
    rs.EnableRedraw(False)
    a = rs.AddSphere([0,0,0], radius)
    b = rs.AddPoints(FibonacciSphere(counts,True,radius))
    rs.EnableRedraw(True)
    return a,b
# Check to see if this file is being executed as the "main" python
# script instead of being used as a module by some other python script
# This allows us to use the module which ever way we want.
if __name__=="__main__":
    a, b = SampleFibonacciSphere()
# ---------- end fib_sph ----------

# ----
merge = Merge(Data1=Slider(0, range=0..5), Data2=Slider(3, range=0..5))
brep_3 = Brep(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)

# ---- group: Shell 指定した面を削除して、厚みを付ける
shell_python = GhPythonScript(Brep=brep_3, faceNum=merge, thickness=Slider(1, range=0..3))  # -> a; inputs Brep: Brep, faceNum: list of Int32
# ---------- shell_python: Python ----------
import rhinoscriptsyntax as rs
import Rhino.Geometry as rg
import ghpythonlib.components as ghc

a = rg.Brep.CreateShell(Brep,faceNum,thickness,0.01)
# ---------- end shell_python ----------

# ----
brep_shell = Brep(shell_python)

# ---- group: Faceの番号確認
debrep = DeconstructBrep(Brep=brep_3)  # -> Faces, Edges, Vertices
evalsrf_2 = EvaluateSurface(Surface=reparameterize(debrep.Faces), Point="0.5,0.5")  # -> Point, Normal, UDirection, VDirection, Frame
points = PointList(Points=evalsrf_2.Point, Size="3")

# ----
# IDE(統合開発環境)などで、書いたpyファイルをリンクして、Grasshopperで実行する
number_slider_4 = Slider(10, range=2..10)
range_2 = Range(Domain=Domain(0, 1), Steps=number_slider_4)
crv = Curve(reparameterize(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))
pt_2 = Point(Point(-8.23624666, 6.581254232, 0))

# ---- group: 右クリックから、'Show "code" input parameter'
python = GhPythonScript(Code=file, Curve=crv, TParams=range_2, Point1=pt_2)  # -> Out, Lines

# ----
crv_2 = Curve(python.Lines)

crv_smash = Curve([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])
pt_smash = Point([Point(88.22760234, -41.68182568, 34.4848943), Point(78.80430434, -17.30016671, 42.97363071), Point(84.19545133, -31.24911615, 43.53549639), Point(75.55266112, -43.40136892, 34.65663139), Point(59.97023444, -45.51535557, 34.86776298), Point(55.88367974, -6.524687934, 18.24613405), Point(66.22660827, -6.524687934, 26.17259244), Point(109.1816939, -29.6222593, 9.235279525), Point(100.1063356, -13.49813728, 4.079047025)])
brep_smash = Brep(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)

# ---- group: Smash 2次元平面に曲面を展開
smash_python = GhPythonScript(Shape=brep_smash, Curves=crv_smash, Points=pt_smash)  # -> S, C, P; inputs Shape: Brep, Curves: list of Curve, Points: list of Point3d
# ---------- smash_python: Python ----------
from Rhino.Geometry import *
import System
        
def unroll(surface, following_curves, following_points):
    unroll = Unroller(surface)
    unroll.AbsoluteTolerance = 0.001
    unroll.RelativeTolerance = 0.2
    unroll.ExplodeOutput = True
    unroll.ExplodeSpacing = 1.0
            
    if following_curves:
        unroll.AddFollowingGeometry.Overloads[System.Collections.Generic.IEnumerable[Curve]](following_curves)
            
    if following_points:
        unroll.AddFollowingGeometry.Overloads[System.Collections.Generic.IEnumerable[Point3d]](following_points)
    breps, curves, points, dots = unroll.PerformUnroll()
    return breps, curves, points
        
if Shape:
    unrolled_surfaces, C, P = unroll(Shape, Curves, Points)
    if len(unrolled_surfaces) >= 1:
        S = unrolled_surfaces
        C = C
        print unrolled_surfaces
    else:
        if not unrolled_surfaces:
            raise RuntimeWarning("Unable")
        else:
            raise RuntimeWarning("unknown")
# ---------- end smash_python ----------

# ----
crv_smash_2 = Curve(smash_python.C)
srf_smash = Surface(smash_python.S)
pt_smash_2 = Point(smash_python.P)
panel_4 = Panel(srf_smash)
panel_5 = Panel(crv_smash_2)
panel_6 = Panel(pt_smash_2)

list = ValueList({"X,Y,Z": 0, "X,Z,Y": 1, "Y,X,Z": 2, "Y,Z,X": 3, "Z,X,Y": 4, "Z,Y,X": 5}, selected="Y,X,Z")
# **************************************************************
# The copyright of this Grasshopper definition is belonged to AppliCraft Co., Ltd.
# The use of this Grasshopper definition is allowed to nonprofit purpose by author's consent.
# 
# 本モデルの著作権は、株式会社アプリクラフトが所有しています。
# 本モデルの使用は作者の同意のもとに非営利目的に限り許可されます。
# **************************************************************
# Script関係
# Display>Canvas Widget>Profiler をオンにして、コンポーネントの計算時間を確認すること。
pt_3 = Point([Point(0, 0, 0), Point(1, 1, 0), Point(0.8, 1.2, 1), Point(3, 0.5, 1.5), Point(2, 1, 1.5), Point(1, 0, 1), Point(2, 0, 1), Point(0, 1, 1)])
panel_7 = Panel(pt_3)

# ---- group: 指定した順に点を並び替える
sortpoints_python = GhPythonScript(points=pt_3, order=list)  # -> out, a; inputs points: list of Point3d, order: Int32
# ---------- sortpoints_python: Python ----------
import rhinoscriptsyntax as rs
import Rhino.Geometry as rg
import ghpythonlib.components as ghc

a = rs.SortPoints(points,True,order)
# ---------- end sortpoints_python ----------

# ----
panel_8 = Panel(sortpoints_python.a)

crv_3 = Curve(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)
srf = Surface(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)

# ---- group: サーフェス上の曲線を、延長する
extendcurveonsurface_python = GhPythonScript(surface=srf, curve=crv_3)  # -> a; inputs surface: Surface, curve: Curve
# ---------- extendcurveonsurface_python: Python ----------
import rhinoscriptsyntax as rs
import Rhino.Geometry as rg
import ghpythonlib.components as ghc

curveDirection = rg.CurveEnd.Both
if surface:
    a = rg.Curve.ExtendOnSurface(curve,curveDirection,surface)
# ---------- end extendcurveonsurface_python ----------

# ----
panel_9 = Panel(extendcurveonsurface_python)

srf_2 = Surface(loft_to_point_python)

# ---- group: 体積のみを求める
volume_c = Volume_CSharp(x=srf_2)  # -> A; inputs x: Brep
# ---------- volume_c: C# usings ----------
using System.IO;
using System.Linq;
using System.Data;
using System.Drawing;
using System.Reflection;
using System.Windows.Forms;
using System.Xml;
using System.Xml.Linq;
using System.Runtime.InteropServices;

using Rhino.DocObjects;
using Rhino.Collections;
using GH_IO;
using GH_IO.Serialization;
# ---------- volume_c: C# ----------
    if(x != null){
      A = x.GetVolume();
    }
# ---------- end volume_c ----------

volume_python = GhPythonScript(x=srf_2)  # -> a; inputs x: Brep
# ---------- volume_python: Python ----------
import rhinoscriptsyntax as rs
import Rhino.Geometry as rg
import ghpythonlib.components as ghc

a = rg.Brep.GetVolume(x)    #RhinoCommon
# ---------- end volume_python ----------

# ---- group: 通常のVolume
volume = Volume(Geometry=srf_2)  # -> Volume, Centroid; disabled

# ----
panel_10 = Panel(volume_c)
panel_11 = Panel(volume_python)
panel_12 = Panel(volume.Volume)

pt_4 = Point(fib_sph.b)
srf_3 = Surface(reparameterize(fib_sph.a))
srf_cp = SurfaceClosestPoint(Point=pt_4, Surface=srf_3)  # -> Point, UVPoint, Distance
evalsrf_3 = EvaluateSurface(Surface=srf_3, Point=srf_cp.UVPoint)  # -> Point, Normal, UDirection, VDirection, Frame
srf_4 = Surface(reparameterize(srf_3))
cir = Circle(Plane=evalsrf_3.Frame, Radius=Slider(0.337, range=0..1))

# ---- group: SurfaceSplit
surfacesplit_python = GhPythonScript(srf=srf_4, crvs=cir)  # -> out, splits; inputs crvs: list of Curve
# ---------- surfacesplit_python: Python ----------
import rhinoscriptsyntax as rs
import Rhino 

def SplitSurfaceWithCurves(srf, crvs):  
    brepObj = rs.coercebrep(srf) 
    face = brepObj.Faces[0]
    
    splitted = Rhino.Geometry.BrepFace.Split(face,
        [rs.coercecurve(crv) for crv in crvs],
        0.001) 
        
    print splitted.Faces
    return [face.DuplicateFace(False) for face in splitted.Faces]

if srf and crvs:
    splits = SplitSurfaceWithCurves(srf, crvs)
# ---------- end surfacesplit_python ----------

# ---- group: 通常のSurfaceSplit
srfsplit = SurfaceSplit(Surface=srf_4, Curves=cir)  # disabled

# ----
srf_5 = Surface(surfacesplit_python.splits)
viewer = ParamViewer(srf_5)

# ---- group: 面積のみを求めるPython
area_python = GhPythonScript(x=srf_5)  # -> out, a; inputs x: Brep
# ---------- area_python: Python ----------
import rhinoscriptsyntax as rs
import Rhino.Geometry as rg
import ghpythonlib.components as ghc

if x:
    a = rg.Brep.GetArea(x)  #RhinoCommon
# ---------- end area_python ----------

# ---- group: 通常のAreaコンポーネント
area = Area(Geometry=srf_5)  # -> Area, Centroid; disabled

# ---- group: 面積のみを求めるC#Script
area_c = Area_CSharp(x=srf_5)  # -> A; inputs x: Brep
# ---------- area_c: C# ----------
    if(x != null){
      A = x.GetArea();
    }
# ---------- end area_c ----------

# ----
sort = SortList(Keys=area_c, ValuesA=srf_5)  # -> Keys, ValuesA
item = ListItem(List=sort.ValuesA, Index="-1", Wrap=True)
preview = CustomPreview(Geometry=item, Material=ColourSwatch(SwatchColor=RGB(115, 115, 115)))
